# Grasshopper definition Honeybee_ElectricLighting_Recipe.gh (Grasshopper 1.0.7)

# Electric Lighting (Legacy)
honeybee = Honeybee_Honeybee()  # -> Vviiiiiiiiiizzz; plug-in component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
ladybug = Ladybug_Ladybug()  # -> Vviiiiiiiiiizzz; plug-in component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

# ----
# (1) Define geometry surfaces in Rhino
windows = Geometry(<brep referenced from the Rhino model>)
walls = Geometry(<brep referenced from the Rhino model>)
ceiling = Geometry(<brep referenced from the Rhino model>)
floor = Geometry(<brep referenced from the Rhino model>)
num = Number(0)
num_2 = Number(3)
num_3 = Number(2)
num_4 = Number(5)
# Developed by Pacific Northwest National Lab (PNNL) with funding from Department of Energy (DOE) Federal Energy Management Program (FEMP) August 2023
createhbsrfs = Honeybee_createHBSrfs(geometry=walls, srfType=num)  # -> readMe, simplify(HBSurface); plug-in component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
createhbsrfs_2 = Honeybee_createHBSrfs(geometry=ceiling, srfType=num_2)  # -> readMe, simplify(HBSurface); plug-in component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
createhbsrfs_3 = Honeybee_createHBSrfs(geometry=floor, srfType=num_3)  # -> readMe, simplify(HBSurface); plug-in component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
createhbsrfs_4 = Honeybee_createHBSrfs(geometry=windows, srfType=num_4)  # -> readMe, simplify(HBSurface); plug-in component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

brep = Brep([createhbsrfs.HBSurface, createhbsrfs_2.HBSurface, createhbsrfs_3.HBSurface, createhbsrfs_4.HBSurface])

# ----
# Set sky to black (0 lx)
# (2) Define sensor grid in Rhino
number_slider = Slider(0.3, range=0.1..10)
sensors = Geometry(<brep referenced from the Rhino model>)
num_5 = Number(0.762)
bool = Boolean(False)
genpts = LBGeneratePointGrid(geometry=sensors, grid_size=number_slider, offset_dist=num_5, quad_only=bool)  # -> points, vectors, face_areas, graft(mesh); plug-in component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
gendarksky = Honeybee_GenerateDarkSky()  # -> skyFilePath; plug-in component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
gridbasedsimulation = Honeybee_GridBasedSimulation(skyFile=gendarksky, testPoints=genpts.points, simulationType=0)  # -> analysisRecipe; plug-in component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

# ----
# (3) IES file path location
panel = Panel("C:\Users\path\to\iesfile\luminaire.ies")

# ----
# (5) Create .rad file
toggle = BooleanToggle(False)

# ----
# (4) Define luminaire points in Rhino
pt = Point([<point referenced from the Rhino model> x2])
iesluminairezone = Honeybee_IESLuminaireZone(ptsList=pt)  # -> readMe, luminaireZone; plug-in component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
iesluminaire = Honeybee_IESLuminaire(
    iesFilePath=panel,
    luminaireZone=flatten(iesluminairezone.luminaireZone),
    lightLossFactor=Slider(0.7, range=0..1),
    candelaMultiplier=Slider(1, range=0..10),
    drawLuminaireWeb=Slider(0, range=0..10),
    writeRad=toggle)  # -> luminaireDetails, luminaireGeo, luminaireList, elecLightingData, radFilePath; plug-in component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

# ----
# (6) RUN SIMULATION
toggle_2 = BooleanToggle(False)

# ----
# Luminaire info
panel_2 = Panel(iesluminaire.luminaireDetails)

rundaylightanalysis = Honeybee_RunDaylightSimulation(
    HBObjects=flatten(brep),
    analysisRecipe=gridbasedsimulation,
    writeRad=toggle_2,
    runRad=toggle_2,
    additionalRadFiles=iesluminaire.radFilePath,
    overwriteResults=True)  # -> readMe, analysisType, resultsUnit, results, testPts, resultFiles, radGeoFile, studyFolder, done; plug-in component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
avglux = GhPythonScript(lx=rundaylightanalysis.results)  # -> average; inputs lx: list
# ---------- avglux: Python ----------
"""Averages illuminance on workplane.
    Inputs:
        lx: The input script variable
    Output:
        average: The output variable"""

__author__ = "mart229"
__version__ = "2023.05.11"

import rhinoscriptsyntax as rs


total = 0

if len(lx) > 0:
    for i in range(len(lx)):
        total += float(lx[i])

    average = total / len(lx)
    print("Average (lx): ")
    print(average) 
    
    average_fc = average * 0.0929
    print("Average (fc): ")
    print(average_fc)

else:
    print("Average (lx): ")
    print(total)
    print("Average (fc): ")
    print(total)
# ---------- end avglux ----------

# ----
# Customize illuminance map
number_slider_2 = Slider(1, range=0..10)
gradientlibrary = Ladybug_GradientLibrary(gradIndex=number_slider_2)  # -> customColors; plug-in component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
legendpar = Ladybug_LegendParameters(customColors=flatten(gradientlibrary))  # -> legendPar; plug-in component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
recolormesh = Ladybug_RecolorMesh(
    analysisResult=rundaylightanalysis.results,
    inputMesh=genpts.mesh,
    legendPar=legendpar,
    analysisTitle=rundaylightanalysis.analysisType,
    legendTitle=rundaylightanalysis.resultsUnit)  # -> readMe, newMesh, newLegend, legendBasePt, meshColors, legendColors; plug-in component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

# ----
# Average illuminance
panel_3 = Panel(avglux)

panel_4 = Panel("This program restores the electric lighting capability of Honeybee within the latest versions of Rhino/Grasshopper/Honeybee. It provides a template for a basic electric lighting simulation in a simple room, and outputs an illuminance map and the average total illuminance in the room.")
panel_5 = Panel("""Honeybee
Radiance
Electric Lighting""")
panel_6 = Panel("C:\Users\mart229\OneDrive - PNNL\Documents\GitHub\Honeybee_ElectricLighting")
toggle_3 = BooleanToggle(True)
exporthydra = Hydra_ExportFile(
    fileName="Honeybee_ElectricLighting_RoomTemplate",
    fileDescription=panel_4,
    fileTags=panel_5,
    targetFolder=panel_6,
    includeRhino=toggle_3,
    GHForThumb=toggle_3,
    export=Toggle(True))  # -> readMe; inputs fileDescription: list, changeLog: list, fileTags: list, includeRhino: Boolean, GHForThumb: Boolean, additionalImgs: list, export: Boolean; plug-in component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
panel_7 = Panel(exporthydra)
